# Grasshopper definition 0001_basic_training.ghx (Grasshopper 1.0.7)

# ----
# 02_add
number_slider = Slider(0.5, range=0..1)
python = GhPythonScript(x=number_slider, y=Slider(0.65, range=0..1))  # -> out, a
# ---------- python: Python ----------
a = x * y
# ---------- end python ----------
panel = Panel(python.a)

series = Series(Start=0, Step=Slider(1, range=0..1), Count=Slider(30, range=0..100))
dom = ConstructDomain(DomainStart=Slider(0, range=0..100), DomainEnd=Slider(22, range=0..100))
python_2 = GhPythonScript(
    nums=series,
    offset=Slider(8.6, range=0..10),
    ang_range=dom,
    ang_num=Slider(10, range=0..10),
    step_height=Slider(62, range=0..100))  # -> out, output; inputs nums: list
# ---------- python_2: Python ----------
__author__ = "horio"
__version__ = "2022.09.23"

import rhinoscriptsyntax as rs

def Spiral(angle):
    arr = []
    for i in range(len(nums)):
        pt = rs.AddPoint([i, 0, 0])
        
        if(i % 2 == 0):
            rs.MoveObject(pt, [offset, 0, 0])
        
        rs.RotateObject(pt, [0, 0, 0], angle * i)
        
        arr.append(pt)
    
    return rs.AddInterpCurve(arr)

spirals = []

for i in range(int(ang_num)):
    min = ang_range.Min
    max = ang_range.Max
    angle = max + (max - min) * i/float(ang_num - 1)
    
    spiral = Spiral(angle)
    
    rs.MoveObject(spiral, [0, 0, i * step_height])
    spirals.append(spiral)

output = spirals
# ---------- end python_2 ----------

# ----
# 05_loop(for)
number_slider_2 = Slider(30, range=0..100)
series_2 = Series(Start=0, Step=Slider(1, range=0..1), Count=number_slider_2)
python_3 = GhPythonScript(nums=series_2)  # -> out, output; inputs nums: list
# ---------- python_3: Python ----------
__author__ = "horio"
__version__ = "2022.06.28"

import rhinoscriptsyntax as rs

arr = []
for i in range(len(nums)):
    pt = rs.AddPoint([nums[i], 0, 0])
    rs.RotateObject(pt, [0, 0, 0], 30 * i)
    arr.append(pt)

output = rs.AddInterpCurve(arr)
# ---------- end python_3 ----------

# ----
# 03_make_point_from_range
number_slider_3 = Slider(100, range=0..100)
range = Range(Domain=number_slider_3, Steps=10)
python_4 = GhPythonScript(range=range)  # -> out, a; inputs range: list
# ---------- python_4: Python ----------
import rhinoscriptsyntax as rs
import Rhino.Geometry as rg

points = []

for x in range:
    for y in range:
        for z in range:
            point = rg.Point3d(x, y, z)
            points.append(point)

a = points
# ---------- end python_4 ----------
panel_2 = Panel(python_4.a)

# ----
# 07_rhino module
number_slider_4 = Slider(30, range=0..100)
series_3 = Series(Start=0, Step=Slider(1, range=0..1), Count=number_slider_4)
python_5 = GhPythonScript(nums=series_3, offset=Slider(5, range=0..10))  # -> out, output; inputs nums: list
# ---------- python_5: Python ----------
__author__ = "horio"
__version__ = "2022.09.21"

import rhinoscriptsyntax as rs
import Rhino.Geometry as geo

arr = []
for i in range(len(nums)):
    pt = geo.Point3d(nums[i], 0, 0)
    
    
    if(i % 2 == 0):
        rs.MoveObject(pt, [offset, 0, 0])
    
    rs.RotateObject(pt, [0, 0, 0], 30 * i)
    arr.append(pt)

output = geo.Curve.CreateInterpolatedCurve(arr, 3)
# ---------- end python_5 ----------

# ----
# 06_condition(if)
number_slider_5 = Slider(30, range=0..100)
series_4 = Series(Start=0, Step=Slider(1, range=0..1), Count=number_slider_5)
python_6 = GhPythonScript(nums=series_4, offset=Slider(5, range=0..10))  # -> out, output; inputs nums: list
# ---------- python_6: Python ----------
__author__ = "horio"
__version__ = "2022.06.28"

import rhinoscriptsyntax as rs

arr = []
for i in range(len(nums)):
    pt = rs.AddPoint([nums[i], 0, 0])
    
    if(i % 2 == 0):
        rs.MoveObject(pt, [offset, 0, 0])
        
    rs.RotateObject(pt, [0, 0, 0], 30 * i)
    arr.append(pt)

output = rs.AddInterpCurve(arr)
# ---------- end python_6 ----------

# ----
# 08_ghpythonlib.components module
number_slider_6 = Slider(30, range=0..100)
Z = UnitZ(Factor=Slider(10, range=0..10))
series_5 = Series(Start=0, Step=Slider(1, range=0..1), Count=number_slider_6)
python_7 = GhPythonScript(x=Z)  # -> out, pt
# ---------- python_7: Python ----------
__author__ = "horio"
__version__ = "2022.09.23"

import rhinoscriptsyntax as rs
import ghpythonlib.components as ghcomp

pt = ghcomp.ConstructPoint(0, 0, 0)
pt = ghcomp.Move(pt, x)[0]
# ---------- end python_7 ----------
python_8 = GhPythonScript(nums=series_5, offset=Slider(5, range=0..10))  # -> out, output; inputs nums: list
# ---------- python_8: Python ----------
__author__ = "horio"
__version__ = "2022.09.23"

import rhinoscriptsyntax as rs
import ghpythonlib.components as ghcomp

arr = []

for i in range(len(nums)):
    pt = ghcomp.ConstructPoint(nums[i], 0, 0)
    
    if(i % 2 == 0):
        pt = ghcomp.Move(pt, ghcomp.UnitX(offset))[0]
    
    cen = ghcomp.ConstructPoint(0, 0, 0)
    
    pt = ghcomp.Rotate(pt, ghcomp.Radians(30) * i, ghcomp.XYPlane(cen))[0]
    
    arr.append(pt)
    
output = ghcomp.Interpolate(arr, 3, False, 0)[0]
# ---------- end python_8 ----------

# ----
# 04_variable
python_9 = GhPythonScript()  # -> out, output1, output2, output3, output4, output5
# ---------- python_9: Python ----------
import rhinoscriptsyntax as rs

val1 = 10 #int
val2 = 2.53 #float
val3 = "ABC" #strings
val4 = True #boolean
val5 = rs.AddPoint(0, 0, 0) #geometry point

output1 = val1
output2 = val2
output3 = val3
output4 = val4
output5 = val5
# ---------- end python_9 ----------
python_10 = GhPythonScript()  # -> out, val
# ---------- python_10: Python ----------
val = 10
val = val + 5
# ---------- end python_10 ----------
panel_3 = Panel(python_10.val)
panel_4 = Panel(python_9.output1)
panel_5 = Panel(python_9.output2)
panel_6 = Panel(python_9.output3)
panel_7 = Panel(python_9.output4)
panel_8 = Panel(python_9.output5)

# ----
# 05_List
series_6 = Series(Start=0, Step=1, Count=10)
panel_9 = Panel(series_6)
python_11 = GhPythonScript(input=series_6)  # -> out, output; inputs input: list
# ---------- python_11: Python ----------
__author__ = "horio"
__version__ = "2022.06.28"

import rhinoscriptsyntax as rs

input.append(10)
input.remove(5)
input.pop(0)

output = input
# ---------- end python_11 ----------
panel_10 = Panel(python_11.output)

# ----
# 9_function
# 値を返さない関数
python_12 = GhPythonScript()  # -> out, a
# ---------- python_12: Python ----------
__author__ = "horio"
__version__ = "2022.09.23"

import rhinoscriptsyntax as rs


def SampleFanc(parm):
    print(parm)
    

SampleFanc('abc')
# ---------- end python_12 ----------

# ----
# 値を返す関数
python_13 = GhPythonScript()  # -> out, a
# ---------- python_13: Python ----------
__author__ = "horio"
__version__ = "2022.09.23"

import rhinoscriptsyntax as rs

def SampleFanc(parm):
    val = parm + 1
    
    return val

print(SampleFanc(4))
# ---------- end python_13 ----------

series_7 = Series(Start=0, Step=Slider(1, range=0..1), Count=Slider(30, range=0..100))
dom_2 = ConstructDomain(DomainStart=Slider(0, range=0..100), DomainEnd=Slider(22, range=0..100))
python_14 = GhPythonScript(
    nums=series_7,
    offset=Slider(8.6, range=0..10),
    ang_range=dom_2,
    ang_num=Slider(10, range=0..10),
    step_height=Slider(62, range=0..100))  # -> out, output; inputs nums: list
# ---------- python_14: Python ----------
__author__ = "horio"
__version__ = "2022.09.23"

import rhinoscriptsyntax as rs

class Spiral:
    def __init__(self, _nums, _offset, _ang_range, _ang_num, _step_height):
        self.nums = _nums
        self.offset = _offset
        self.ang_range = _ang_range
        self.ang_num = _ang_num
        self.step_height = _step_height

    def CreateSpiral(self, angle):
        arr = []
        for i in range(len(self.nums)):
            pt = rs.AddPoint([i, 0, 0])
            
            if(i % 2 == 0):
                rs.MoveObject(pt, [self.offset, 0, 0])
            
            rs.RotateObject(pt, [0, 0, 0], angle * i)
            
            arr.append(pt)
        
        return rs.AddInterpCurve(arr)

    def CreateSpirals(self):
        spirals = []
        
        for i in range(int(self.ang_num)):
            min = self.ang_range.Min
            max = self.ang_range.Max
            angle = max + (max - min) * i/float(self.ang_num - 1)
            
            spiral = self.CreateSpiral(angle)
            
            rs.MoveObject(spiral, [0, 0, i * self.step_height])
            spirals.append(spiral)
        
        return spirals

spiral = Spiral(nums, offset, ang_range, ang_num, step_height)
spirals = spiral.CreateSpirals()

output = spirals
# ---------- end python_14 ----------
loft = Loft(
    Curves=python_14.output,
    Options={Adjust=False, Closed=False, LoftEnds=0, LoftSimp=0, LoftType=0, Rebuild=10, Refit=0.01})
preview = CustomPreview(Geometry=loft, Material=ColourSwatch(SwatchColor=RGB(255, 255, 255)))

# ----
# 10_class
# クラスの基本
python_15 = GhPythonScript()  # -> out, a
# ---------- python_15: Python ----------
__author__ = "horio"
__version__ = "2022.09.23"

import rhinoscriptsyntax as rs

class SampleClass:
    def __init__(self, _name):
        self.name = _name
    
    def GetName(self):
        print("name is" + self.name)

instancel1 = SampleClass("Mac")
instancel2 = SampleClass("Bob")

instancel1.GetName()
instancel2.GetName()
# ---------- end python_15 ----------

# ----
# 01_hello, world
python_16 = GhPythonScript()  # -> out, a
# ---------- python_16: Python ----------
a = "hello, world"
# ---------- end python_16 ----------
panel_11 = Panel(python_16.a)
