# Grasshopper definition 0002_sine_hat.ghx (Grasshopper 1.0.7)

r = Slider(30, range=20..50)
dis = Slider(14, range=0..19)
z = Slider(80, range=0..100)
div = Slider(21, range=5..50)
shift = Slider(7, range=0..10)
ribbon = Slider(4.4, range=1..10)
python = GhPythonScript(r=r, dis=dis, z=z, div=div, shift=shift, ribbon=ribbon)  # -> out, a, b, c, d, e
# ---------- python: Python ----------
__author__ = "horio"
__version__ = "2022.09.26"

import rhinoscriptsyntax as rs
import Rhino.Geometry as rg
import ghpythonlib.components as gh
import math

circles = []

circle1 = rs.AddCircle([0, 0, 0], r)
circles.append(circle1)
pts1 = rs.DivideCurve(circle1, div)

circle2 = rs.AddCircle([0, 0, 0], r - dis)
circle2 = rs.MoveObject(circle2, rg.Vector3d(0, 0, z))
circles.append(circle2)
pts2 = rs.DivideCurve(circle2, div)

a = circles

surfaces = []

for i in range(pts1.Count):
    p1 = pts1[i]
    p2 = pts2[int((i + shift) % pts1.Count)]
    
    line = gh.Line(p1, p2)
    len = gh.Length(line)
    divPts = gh.DivideCurve(line, 20, False)[0]
    dir = gh.Vector2Pt(p1, p2, True)[0]
    dir = gh.CrossProduct(dir, gh.UnitZ(1.0), True)[0]
    
    oldPts = []
    newPts = []
    
    for j in range(divPts.Count):
        pt = divPts[j]
        pt = gh.Move(pt, -gh.UnitZ(gh.Sine(j / float(divPts.Count - 1) * math.pi) * 20.0))[0]
        
        oldPts.append(pt)
        ampV = gh.Amplitude(dir, ribbon)
        pt2 = gh.Move(pt, ampV)[0]
        newPts.append(pt2)
    
    b = oldPts
    c = newPts
# ---------- end python ----------
pt = Point(python.b)
pt_2 = Point(python.c)
